# Grasshopper definition GH_Template.gh (Grasshopper 1.0.7)
# plug-ins: EleFront, MeshEdit Components

# ----
# Parameters
# If the script uses certain parameters multiple times, if certain parameters are important, place them here for easy control. Explain in this panel what they do and how to use them.
# 
# In the case of this example value lists are provided to choose between simple forms on one hand and type of geometry on the other. Besides that sliders control the width, length and/or height of the chosen geometry.
height = Slider(5, range=0..10)
width = Slider(10, range=0..140)
length = Slider(4, range=0..40)

# ----
# Main Title
# Provide an overall description of what the script does, what data it requires and what data it generates.
# 
# This script is an example which can be used as a template. The content can be ignored, but what is relevant is the way of organizing the script with groups, titles and description, and how to refer to geometry and bake it in a way it can be used by preceding or succeeding scripts.
list = ValueList({"Box": 0, "Sphere": 1, "Ellipsoid": 2}, selected="Ellipsoid")
list_2 = ValueList({"NURBS": 0, "Mesh": 1}, selected="Mesh")

# ----
# Refer to Geometry
# Use pipelines to refer to geometry from Rhino, which may have been generated in a preceding script. Explain this with other relevant information in this panel.
pipeline = GeometryPipeline(
    GroupByLayer=False,
    GroupByType=False,
    IncludeHidden=True,
    IncludeLocked=True,
    LayerFilter="LayerName::SubLayerName",
    NameFilter="*",
    SublayerFiltering=True,
    TypeFilter=1)
pipeline_2 = GeometryPipeline(
    GroupByLayer=False,
    GroupByType=False,
    IncludeHidden=True,
    IncludeLocked=True,
    LayerFilter="LayerName::SubLayerName",
    NameFilter="*",
    SublayerFiltering=True,
    TypeFilter=32)

# ----
# Geometry if none provided
vec = VectorXYZ(XComponent=0, YComponent=0, ZComponent=0)  # -> Vector, Length
null = NullItem(Item=pipeline)  # -> NullFlags, InvalidFlags, Description
filter = StreamFilter(Gate=null.InvalidFlags, Stream0=pipeline, Stream1=vec.Vector)

gate = StreamGate(Stream=filter, Gate=list)  # -> Target0, Target1, Target2

# ---- group: Ellipsoid
# Provide a detailed description of how and why components are used and connected in this part of the script.
# 
# If 'Mesh' is selected as the type of geometry, it is generated here. In the 'Ellipsoid' group the mesh vertices converge at the ends and therefore need to be alligned and welded.
ellipse = Ellipse(Plane=gate.Target2, Radius1=width, Radius2=length)  # -> Ellipse, Focus1, Focus2
ln = Line(StartPoint=ellipse.Focus1, EndPoint=ellipse.Focus2)
revsrf = Revolution(Curve=ellipse.Ellipse, Axis=ln, Domain=Domain(0, 3.141592654))

mesh = MeshBrep(
    Brep=revsrf,
    Settings={GridMaxCount=0, GridMinCount=16, JaggedSeams=False, MaxEdgeLength=0, MinEdgeLength=0.0001, MinTolerance=0, Refine=True, RefineAngle=0, RelativeTolerance=0.65, SimplePlanes=True, Tolerance=0})
alignvert = AlignVertices(Mesh=mesh, Tolerance=0.01)  # -> Result, Count
weldvertices = MeshWeldVertices(Mesh=alignvert.Result, Tolerance=0.01)  # -> RuntimeMessage, Mesh
unim = UnifyMesh(Mesh=weldvertices.Mesh)  # -> Result, Count

# ---- group: Box
# Main Script
# Provide a description of the organization and characteristics of the group.
# 
# The script is divided in groups according to the optional forms/types of geometry. The components are only computing when the corresponding option in the value list is selected by exclusively providing data to those specific components.
dom = ConstructDomain(DomainStart=expr("-x/2", width), DomainEnd=expr("x/2", width))
dom_2 = ConstructDomain(DomainStart=expr("-x/2", length), DomainEnd=expr("x/2", length))
dom_3 = ConstructDomain(DomainStart=0, DomainEnd=height)
box = DomainBox(Base=gate.Target0, X=dom, Y=dom_2, Z=dom_3)

mbox = MeshBox(Base=box, XCount=10, YCount=10, ZCount=10)

# ---- group: Sphere
msphere = MeshSphere(Base=gate.Target1, Radius=width, UCount=20, VCount=40)

# ----
# NURBS
# Provide a detailed description of how and why components are used and connected in this part of the script.
# 
# If NURBS is selected as the type of geometry, it is generated here.
sph = Sphere(Base=gate.Target1, Radius=width)
merge = Merge(Data1=box, Data2=sph, Data3=revsrf)

# ----
# Mesh
merge_2 = Merge(Data1=mbox, Data2=msphere, Data3=unim.Result)

filter_2 = StreamFilter(Gate=list_2, Stream0=merge, Stream1=merge_2)

# ----
# Bake
panel = Panel("NURBS")
# Provide a detailed description of how and why components are used and connected in this part of the script.
# 
# In this group the geometry can be baked. It is baked in layers specified according to type- and form of the geometry. Also a name is provided related to these properties. This will ensure that if the geometry is changed and baked again, it will replace the former baked geometry with the same name.
bake = Button()
filter_3 = StreamFilter(Gate=list, Stream0="Box", Stream1="Sphere", Stream2="Ellipsoid")
filter_4 = StreamFilter(Gate=list_2, Stream0=panel, Stream1="Mesh")
concat = Concatenate(FragmentA="Geometry::", FragmentB=filter_4, FragmentD="::", FragmentC=filter_3)
attributes = DefineObjectAttributes(Layer=concat, Color=ColourSwatch(SwatchColor=RGB(224, 224, 224)))
concat_2 = Concatenate(FragmentA=filter_3, FragmentC=" ", FragmentB=filter_4)
bake_2 = BakeObjects(Geometry=filter_2, Attributes=graft(attributes), BakeName=concat_2, Bake=bake)
